# Dynamo graph ExampleFile.dyn (Dynamo 2.12.0.5650)
# packages: Sandbox 1.0.0.0

file_path = Filename("C:\Users\BIA97506\Mott MacDonald\Sydney Computational Design Team - Documents\ExcelReaderAndWriter\test sheets\20170208 371138 Core Walls.xlsm")
file_path_2 = Filename("..\..\..\..\..\..\Mott MacDonald\Sydney Computational Design Team - Documents\02_Tools\003_ExcelReaderAndWriter\test sheets\Haven Lateral calculation.csv")
CSV = Sandbox.ExcelTools.Reader.CSV(filePath=file_path_2)
watch = Watch(CSV)
file_path_3 = Filename("..\..\..\..\..\..\Mott MacDonald\Sydney Computational Design Team - Documents\02_Tools\003_ExcelReaderAndWriter\test sheets\Haven Lateral calculation.xls")
sheetNames = Sandbox.ExcelTools.Reader.SheetNames(filePath=file_path_3)
file_path_4 = Filename("..\..\..\..\..\..\Mott MacDonald\Sydney Computational Design Team - Documents\02_Tools\003_ExcelReaderAndWriter\test sheets\AS4100 - Steel bending custom sections.xlsx")
code_block = CodeBlock { "T-Section"; ["T-Section","Custom Section"]; 1; [0,1]; "A0:B5"; }
excel = Sandbox.ExcelTools.Reader.Excel(filePath=file_path_4, sheet=code_block.out0, cellRange=code_block.out4)
excel_2 = Sandbox.ExcelTools.Reader.Excel(filePath=file_path_4, sheet=code_block.out2)
python_script = Python()  # CPython3; unwired: IN[0]
# ---------- python_script.python (3 lines) ----------
# Load the Python Standard and DesignScript Libraries
import os
OUT = os.path.expanduser("~\\Desktop")
# ----------------------------------------
code_block_2 = CodeBlock { "TestFile"; "SheetName"; "SheetName2"; ["ID", "Shape", "Area"]; }
code_block_3 = CodeBlock()
# ---------- code_block_3.designscript (3 lines) ----------
[["001", "003", "004"],
["Triangle", "Square", "Circle"],
[10, 50, 60]];
# ----------------------------------------
dataSheet = Sandbox.ExcelTools.Writer.DataSheet(sheetName=code_block_2.out1, headers=code_block_2.out3, data=code_block_3)
dataSheet_2 = Sandbox.ExcelTools.Writer.DataSheet(sheetName=code_block_2.out2, headers=code_block_2.out3, data=code_block_3)
join = List.Join(list0=dataSheet, list1=dataSheet_2)
boolean = BoolSelector(false)
excel_3 = Sandbox.ExcelTools.Writer.Excel(path=python_script, fileName=code_block_2.out0, sheets=join, save=boolean)
code_block_4 = CodeBlock()
# ---------- code_block_4.designscript (11 lines) ----------
[Point.ByCoordinates(2.007487, 8.3117, 0),
Point.ByCoordinates(2.007487, 7.180412, 0),
Point.ByCoordinates(2.007487, 6.464235, 0),
Point.ByCoordinates(2.007487, 4.176446, 0),
Point.ByCoordinates(3.367784, 4.176446, 0),
Point.ByCoordinates(4.640987, 4.176446, 0),
Point.ByCoordinates(5.996631, 4.709117, 0),
Point.ByCoordinates(7.200084, 5.716088, 0),
Point.ByCoordinates(7.200084, 6.526576, 0),
Point.ByCoordinates(7.200084, 7.435306, 0),
Point.ByCoordinates(5.308944, 7.435306, 0)];
# ----------------------------------------
removeCollinear = Sandbox.GeometryTools.Points.RemoveCollinear(pts=code_block_4)
